# Grasshopper definition AIA-GeoOpt-HeshamShawqy_ASS03.gh (Grasshopper 1.0.7)
# plug-ins: Human, Kangaroo2 Components, Hops

number_slider = Slider(5, range=0..10)
custom_mesh_settings = SettingsCustom(
    StitchSeams=True,
    SimplePlanes=False,
    Refine=True,
    MinCount=16,
    MaxCount=400,
    AspectRatio=20,
    MaxDistance=0,
    MaxAngle=20,
    MinEdge=number_slider,
    MaxEdge=number_slider)
genes = GenePool(Decimals=2, Maximum=1, Minimum=0, Value=[0.94, 0.08, 0.78, 0.42, 0.32, 0.14])
genes_2 = GenePool(Decimals=2, Maximum=1, Minimum=0, Value=[0.13, 0.84, 0.52, 0.02, 0.61, 0.1])
boundary = BoundarySurfaces(Edges=[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], UseTasks=False)
mesh = MeshBrep(Brep=boundary, Settings=custom_mesh_settings)
mesh_2 = Mesh(mesh)
pt = ConstructPoint(XCoordinate=genes, YCoordinate=genes_2, ZCoordinate=0)
evalsrf = EvaluateSurface(Surface=reparameterize(boundary), Point=pt)  # -> Point, Normal, UDirection, VDirection, Frame
panel = Panel("http://127.0.0.1:5000/MeshPathWalker")
pt_2 = Point([Point(698.8532021, 498.0138532, 0), Point(777.3521563, 466.3138188, 0), Point(798.205215, 381.8513543, 0), Point(774.0759574, 305.6611633, 0), Point(597.4731664, 422.8276627, 0), Point(659.2149561, 437.9816365, 0)])
unit_z = UnitZ(Factor=Slider(4, range=0..10))
data = Data(evalsrf.Point)
curve = Curve([<curve referenced from the Rhino model> x170])
list = ValueList({"edgeLength", "sameWeight"}, selected="edgeLength")
list_2 = ValueList({"vertexGraph", "faceGraph"}, selected="vertexGraph")
boundary_surfaces = BoundarySurfaces(Edges=curve)
prox = Proximity2D(Points=data, Plane=PlaneXY(0, 0, 0), Group=Slider(3, range=0..10))  # -> flatten(Links), Topology
list_3 = ValueList({"dijkstra": "dijkstra_path", "shortest": "shortest_path"}, selected="dijkstra")
extrude = Extrude(Base=boundary_surfaces, Direction=unit_z)
dupln = RemoveDuplicateLines(Lines=prox.Links, Tolerance=0.01)
hops = Hops(
    Mesh=mesh_2,
    WeightMode=list,
    GraphType=list_2,
    SLine=dupln,
    Mode=list_3,
    CacheResultsInMemory=True,
    CacheSolveResults=True,
    RemoteDefinitionLocation="http://127.0.0.1:5000/MeshPathWalker",
    RemoteSolveVersion=(0, 1, 0))  # -> ShortestPath, FacesIndex
custom_preview = CustomPreview(Geometry=extrude, Material=ColourSwatch(SwatchColor=RGBA(135, 135, 135, 166)))
custom_preview_2 = CustomPreview(Geometry=boundary, Material=ColourSwatch(SwatchColor=RGB(33, 31, 31)))
pline = PolyLine(Vertices=hops.ShortestPath, Closed=False)
explode = Explode(Curve=pline, Recursive=True)  # -> flatten(Segments), Vertices
midpt = CurveMiddle(Curve=explode.Segments)

# ---- group: WALKABILITY CRITERIA
mesh_3 = Mesh(extrude)
volume = Volume(Geometry=mesh_3)  # -> Volume, Centroid
project = Project(Geometry=volume.Centroid, Plane=PlaneXY(0, 0, 0))  # -> Geometry, Transform
pull = PullPoint(Point=project.Geometry, Geometry=midpt, ClosestOnly=True)  # -> ClosestPoint, Distance
walkability_radius = Panel("20")
ln = Line(StartPoint=pull.ClosestPoint, EndPoint=project.Geometry)
larger = LargerThan(FirstNumber=pull.Distance, SecondNumber=walkability_radius)  # -> LargerThan, OrEqualTo
cull = CullPattern(List=ln, CullPattern=invert(larger.LargerThan))
lng = ListLength(List=cull)
custom_preview_lineweights = CustomPreviewLineweights(Geometry=cull, Shader=ColourSwatch(SwatchColor=RGB(255, 255, 255)), Thickness=Slider(0, range=0..100), Absolute=False)
number_of_accessible_buildings = Data(lng)

# ----
pull_2 = PullPoint(Point=midpt, Geometry=flatten(project.Geometry), ClosestOnly=True)  # -> ClosestPoint, Distance
Z = UnitZ(Factor=1)
move = Move(Geometry=explode.Segments, Motion=Z)  # -> Geometry, Transform
bnd = Bounds(Numbers=pull_2.Distance)
number_slider_2 = Slider(133, range=0..1000)  # disabled
number_slider_3 = Slider(375, range=0..1000)  # disabled
panel_2 = Panel("NO. OF ACCESSIBLE BUILDINGS = ")  # disabled
remap = RemapNumbers(Value=pull_2.Distance, Source=bnd, Target=Domain(0, 1))  # -> Mapped, Clipped
swatch = ColourSwatch(SwatchColor=RGB(255, 255, 255))  # disabled
gradient = Gradient(
    LowerLimit=0,
    UpperLimit=1,
    Parameter=remap.Mapped,
    stops=[0: RGB(234, 38, 0), 0.25: RGB(234, 126, 0), 0.5: RGB(254, 244, 84), 0.75: RGB(173, 203, 249), 1: RGB(75, 107, 169)])
pt_3 = ConstructPoint(XCoordinate=number_slider_3, YCoordinate=number_slider_2, ZCoordinate=0)  # disabled
concat = Concatenate(FragmentA=panel_2, FragmentB=number_of_accessible_buildings)  # disabled
galapagos = Galapagos(fitness=number_of_accessible_buildings, gene=[genes, genes_2])
custom_preview_lineweights_2 = CustomPreviewLineweights(Geometry=move.Geometry, Shader=gradient, Thickness=Slider(9, range=0..100), Absolute=False)
panel_3 = Panel("LATO")  # disabled
texttoscreen = RenderTextToScreen(Text=concat, Location=pt_3, Size=12, Color=swatch, Font=panel_3, m_scWithvp=False)  # disabled
